vi "FrameSync(Real).gvi"   [LabVIEW NXG 3.0.0]
inputs:
  "Input Signal": cluster{"t0": f64, "dt": f64, "Y": f64[]}
  "Sampled Input": f64[]
  "Receiver Sampling Factor": f64 = 20
  "error in (no error)": error
outputs:
  "Output Signal": cluster{"t0": f64, "dt": f64, "Y": f64[]}
  "Aligned Samples": f64[]
  "max index": i32
  "error out": error
panel indicators:
  "Cross Correlation": f64[]
uses:
  NI::Analysis::Operations::1D Cross Correlation (DBL).gvi
  NI::Analysis::Measurement::Threshold Detector (1D DBL).gvi
  NI::G Core::Error::Legacy::Error Cluster From Error Code.gvi
diagram:
  case ($"error in (no error)") {
    frame No Error {
      Property Node(instance in=$"Input Signal") -> ("dt"=w4, "Y"=w5)
      call "Normalize Vector.gvi"(Vector=$"Sampled Input") -> (Normalized Vector=w6, error=w7)
      Build Array([1, 1, 1, 1, 1, -1, -1, 1, 1, -1, 1, -1, 1], [1, 1, 1, 1, 1, -1, -1, 1, 1, -1, 1, -1, 1]) -> w8
      call "1D Cross Correlation (DBL).gvi"(x=w8, y=w6) -> (Rxy=w9, error out=w10)
      Absolute Value(x=w9) -> w11
      call "Threshold Detector (1D DBL).gvi"(signal=w11, width=20) -> (locations=w12)
      Array Index(array=w12) -> (out0[0]=w13)
      Increment(x=w13) -> w14
      Subtract(x=w14, y=26) -> w15
      Multiply($"Receiver Sampling Factor", w15) -> w16
      Array Subset(array=w5, index0=w16) -> w17
      w18 = cluster{"t0": f64, "dt": f64, "Y": f64[]} {all zero or empty}
      Property Node(instance in=w18, "dt"=w4, "Y"=w17) -> (instance out=w3)
      $"Cross Correlation" <- w11
      Array Subset(array=$"Sampled Input", index0=w14) -> w1
      $"max index" <- w13
      call "Error Cluster From Error Code.gvi"(error code=w7, error message="Normalize", error in=$"error in (no error)") -> (error out=w19)
      Property Node(instance in=w10) -> ("code"=w20)
      call "Error Cluster From Error Code.gvi"(error code=w20, error message="Sliding Correlator: crosscorrelation", error in=w19) -> (error out=w2)
    }
    frame Error {
      w21 = cluster{"t0": f64, "dt": f64, "Y": f64[]} {all zero or empty}
      w1 = f64[] []
      w2 = $"error in (no error)"
      w3 = w21
    }
  }
  $"Output Signal" <- w3
  $"Aligned Samples" <- w1
  $"error out" <- w2
