vi "Chebyshev Filter (CDB).gvi"   [LabVIEW NXG 3.0.0]
inputs:
  "filter type": T1 = "Lowpass"
  "X": c128[]
  "sampling freq: fs": f64 = 1
  "high cutoff freq: fh": f64 = 0.505
  "low cutoff freq: fl": f64 = 495
  "ripple(dB)": f64 = 0.1
  "order": i32 = 2
  "init/cont (init:F)": bool
outputs:
  "Filtered X": c128[]
  "error": i32
types:
  T1 = enum{"Lowpass", "Highpass", "Bandpass", "Bandstop"}
uses:
  NI::Analysis::Filtering::Chebyshev Coefficients.gvi
  NI::Analysis::Filtering::IIR Cascade Filter (CDB).gvi
diagram:
  call "Chebyshev Coefficients.gvi"(order=$order, sampling frequency=$"sampling freq: fs", high cutoff frequency=$"high cutoff freq: fh", low cutoff frequency=$"low cutoff freq: fl", ripple=$"ripple(dB)", filter type=$"filter type") -> (IIR filter cluster=w1, error=w2)
  Is Equal To 0(x=w2) -> w3
  case (w3) {
    frame False, Default {
      w4 = c128[] []
      w5 = w2
    }
    frame True {
      call "IIR Cascade Filter (CDB).gvi"(x=$X, IIR filter cluster=w1, init?=$"init/cont (init:F)") -> (filtered x=w4, error=w5)
    }
  }
  $"Filtered X" <- w4
  $error <- w5
