vi "Lab2Rx.gvi"   [LabVIEW NXG 3.0.0]
panel controls:
  "IQ rate": f64 = 1000000
  "carrier frequency": f64 = 915000000
  "gain (dB)": f64
  "active antenna": string = "RX2"
  "number of samples": i64 = 200000
  "Device names": string
  "stop": bool
panel indicators:
  "actual IQ rate": f64
  "actual carrier frequency": f64
  "actual gain (dB)": f64
  "error out": error
  "Baseband Output": f64[]
  "Power Spectrum": T1
  "Graph": f64[]
types:
  T1 = cluster{"f0": f64, "df": f64, "magnitude": f64[]}
uses:
  NI::USRP::niUSRP Open Rx Session.gvi
  NI::USRP::niUSRP Configure Signal.gvi
  NI::USRP::niUSRP Initiate.gvi
  NI::USRP::niUSRP Fetch Rx Data (CDB WDT).gvi
  NI::Analysis::Filtering::Butterworth Filter Design.gvi
  NI::Analysis::Filtering::Filtering (DBL).gvi
  NI::USRP::niUSRP Abort.gvi
  NI::USRP::niUSRP Close Session.gvi
  NI::G Core::Error::Legacy::Simple Error Handler.gvi
diagram:
  call "niUSRP Open Rx Session.gvi"(device names=$"Device names") -> (session handle out=w1, error out=w2)
  call "niUSRP Configure Signal.gvi"(active antenna=$"active antenna", session handle=w1, error in=w2, IQ rate=$"IQ rate", carrier frequency=$"carrier frequency", gain=$"gain (dB)") -> (session handle out=w3, error out=w4, coerced IQ rate=w5, coerced carrier frequency=w6, coerced gain=w7)
  call "niUSRP Initiate.gvi"(session handle=w3, error in=w4) -> (session handle out=w8, error out=w9)
  w10 = $"number of samples"
  w11 = $stop
  while {
    call "niUSRP Fetch Rx Data (CDB WDT).gvi"(session handle=w8, error in=w9, number of samples=w10, timeout=50) -> (session handle out=w12, error out=w13, data=w14)
    Property Node(instance in=w14) -> ("Y"=w15, "dt"=w16)  # Complex waveform properties
    # demodulated data
    call "Chebyshev Filter (CDB).gvi"(X=w15, sampling freq: fs=w5, high cutoff freq: fh=105000, low cutoff freq: fl=95000, filter type="Bandpass") -> (Filtered X=w17)
    # data
    Complex To Real Imaginary(x + iy=w17) -> (x=w18)
    # data convert to DBL
    Absolute Value(x=w18) -> w19
    # filter design: Butterworth
    call "Butterworth Filter Design.gvi"(sampling frequency=w5, filter type="Lowpass", low cutoff frequency=5000, high cutoff frequency=0) -> (filter=w20)
    # filtering
    call "Filtering (DBL).gvi"(signal=w19, filter=w20) -> (filtered signal=w21)
    $"Baseband Output" <- w21
    w22 = cluster{"t0": timestamp, "dt": f64, "Y": c128[]} {all zero or empty}
    Property Node(instance in=w22, "Y"=w17, "dt"=w16) -> (instance out=w23)
    call "FFT Power Spectrum for 1 Chan (CDB)2.gvi"(time signal=w23, dB On (F)=TRUE) -> (power spectrum=w24)
    $"Power Spectrum" <- w24
    Logical Or(w13, w11) -> w25
    # sampling frequency
    Complex To Real Imaginary(x + iy=w15) -> (x=w26)
    $Graph <- w26
    stop if w25
  }
  call "niUSRP Abort.gvi"(session handle=w12, error in=w13) -> (session handle out=w27, error out=w28)
  call "niUSRP Close Session.gvi"(session handle=w27, error in=w28) -> (error out=w29)
  call "Simple Error Handler.gvi"(error in=w29) -> (error out=w30)
  $"error out" <- w30
  $"actual IQ rate" <- w5
  $"actual carrier frequency" <- w6
  $"actual gain (dB)" <- w7
