vi "Lab2_Operators.gvi"   [LabVIEW NXG 3.0.0]
inputs:
  "D": f64
  "m": f64[]
  "mu": f64
  "mp": f64
outputs:
  "product": f64[]
panel controls:
  "1": f64
diagram:
  Divide(x=$m, y=$mp) -> w1
  Multiply($mu, w1) -> w2
  Add($"1", w2) -> w3
  Multiply($D, w3) -> w4
  $product <- w4
