vi "Lab3Rx.gvi"   [LabVIEW NXG 3.0.0]
panel controls:
  "IQ rate": f64 = 2000000
  "carrier frequency": f64 = 915000000
  "gain (dB)": f64
  "active antenna": string = "RX2"
  "number of samples": i64 = 200000
  "Device names": string
  "stop": bool
panel indicators:
  "actual IQ rate": f64
  "actual carrier frequency": f64
  "actual gain (dB)": f64
  "error out": error
  "Message 2 out": waveform<f64>
  "Message 1 out": waveform<f64>
  "Power Spectrum": T1
  "Power 1": f64[]
  "Power 2": f64[]
types:
  T1 = cluster{"f0": f64, "df": f64, "magnitude": f64[]}
uses:
  NI::USRP::niUSRP Open Rx Session.gvi
  NI::USRP::niUSRP Configure Signal.gvi
  NI::USRP::niUSRP Initiate.gvi
  NI::USRP::niUSRP Fetch Rx Data (CDB WDT).gvi
  NI::USRP::niUSRP Abort.gvi
  NI::USRP::niUSRP Close Session.gvi
  NI::G Core::Error::Legacy::Simple Error Handler.gvi
diagram:
  call "niUSRP Open Rx Session.gvi"(device names=$"Device names") -> (session handle out=w1, error out=w2)
  call "niUSRP Configure Signal.gvi"(active antenna=$"active antenna", session handle=w1, error in=w2, IQ rate=$"IQ rate", carrier frequency=$"carrier frequency", gain=$"gain (dB)") -> (session handle out=w3, error out=w4, coerced IQ rate=w5, coerced carrier frequency=w6, coerced gain=w7)
  call "niUSRP Initiate.gvi"(session handle=w3, error in=w4) -> (session handle out=w8, error out=w9)
  while {
    call "niUSRP Fetch Rx Data (CDB WDT).gvi"(session handle=w8, error in=w9, number of samples=$"number of samples") -> (session handle out=w10, error out=w11, data=w12)
    Property Node(instance in=w12) -> ("Y"=w13, "dt"=w14)
    call "Chebyshev Filter (CDB).gvi"(X=w13, sampling freq: fs=w5, high cutoff freq: fh=505000, low cutoff freq: fl=495000) -> (Filtered X=w15)
    Complex To Real Imaginary(x + iy=w15) -> (x=w16)
    call "Butterworth Filter (DBL).gvi"(X=w16, sampling freq: fs=w5, high cutoff freq: fh=5000, low cutoff freq: fl=0) -> (Filtered X=w17)
    $"Power 1" <- w17
    Logical Or(w11, $stop) -> w18
    Build Waveform Node(Y=w17, dt=w14) -> (output waveform=w19)
    $"Message 1 out" <- w19
    Property Node(instance in=w12) -> ("Y"=w20, "dt"=w21)
    call "Chebyshev Filter (CDB).gvi"(X=w20, sampling freq: fs=w5, high cutoff freq: fh=515000, low cutoff freq: fl=505000) -> (Filtered X=w22)
    Complex To Real Imaginary(x + iy=w22) -> (x=w23)
    call "Butterworth Filter (DBL).gvi"(X=w23, sampling freq: fs=w5, high cutoff freq: fh=5000, low cutoff freq: fl=0) -> (Filtered X=w24)
    $"Power 2" <- w24
    Build Waveform Node(Y=w24, dt=w21) -> (output waveform=w25)
    $"Message 2 out" <- w25
    stop if w18
  }
  call "niUSRP Abort.gvi"(session handle=w10, error in=w11) -> (session handle out=w26, error out=w27)
  call "niUSRP Close Session.gvi"(session handle=w26, error in=w27) -> (error out=w28)
  call "Simple Error Handler.gvi"(error in=w28) -> (error out=w29)
  $"error out" <- w29
  $"actual IQ rate" <- w5
  $"actual carrier frequency" <- w6
  $"actual gain (dB)" <- w7
