vi "Lab3Tx.gvi"   [LabVIEW NXG 3.0.0]
panel controls:
  "IQ rate": f64 = 2000000
  "carrier frequency": f64 = 915000000
  "gain (dB)": f64
  "active antenna": string = "TX1"
  "message length (samples)": f64 = 200000
  "start frequency 1": f64 = 100
  "delta frequency 1": f64 = 100
  "#tones 1": i32 = 3
  "Modulation index 1": f64 = 1
  "Subcarrier frequency 1": f64 = 500000
  "start frequency 2": f64 = 1000
  "delta frequency 2": f64 = 1000
  "#tones 2": i32 = 3
  "Modulation index 2": f64 = 1
  "Subcarrier frequency 2": f64 = 510000
  "Device names": string
  "stop": bool
panel indicators:
  "actual IQ rate": f64
  "actual carrier frequency": f64
  "actual gain (dB)": f64
  "error out": error
  "Message": f64[]
  "Baseband Signal": f64[]
uses:
  NI::USRP::niUSRP Open Tx Session.gvi
  NI::USRP::niUSRP Configure Signal.gvi
  NI::USRP::niUSRP Write Tx Data (CDB).gvi
  NI::USRP::niUSRP Close Session.gvi
  NI::G Core::Error::Legacy::Simple Error Handler.gvi
diagram:
  call "niUSRP Open Tx Session.gvi"(device names=$"Device names") -> (session handle out=w1, error out=w2)
  call "niUSRP Configure Signal.gvi"(active antenna=$"active antenna", session handle=w1, error in=w2, IQ rate=$"IQ rate", carrier frequency=$"carrier frequency", gain=$"gain (dB)") -> (session handle out=w3, error out=w4, coerced IQ rate=w5, coerced carrier frequency=w6, coerced gain=w7)
  Property Node(instance in=cluster{"Fs": f64, "#s": f64} {"Fs"=1000, "#s"=1000}, "#s"=$"message length (samples)", "Fs"=w5) -> (instance out=w8)
  w9 = TRUE  # coerce frequencies
  call "Basic Multitone.gvi"(sampling info=w8, coerce frequencies?=w9, phase relationship="random", start frequency=$"start frequency 1", delta frequency=$"delta frequency 1", #tones=$"#tones 1", amplitude=1) -> (signal out=w10)
  Property Node(instance in=w10) -> ("Y"=w11)
  w12 = 1  # carrier level 1
  call "Quick Scale 1D.gvi"(X=w11) -> (max|X|=w13)
  call "AM.gvi"(mu=$"Modulation index 1", mp=w13, m=w11, A=w12, fc=$"Subcarrier frequency 1") -> (G=w14)
  w15 = FALSE  # coerce frequencies
  call "Basic Multitone.gvi"(sampling info=w8, coerce frequencies?=w15, phase relationship="random", start frequency=$"start frequency 2", delta frequency=$"delta frequency 2", #tones=$"#tones 2", amplitude=1) -> (signal out=w16)
  Property Node(instance in=w16) -> ("Y"=w17)
  w18 = 1  # carrier level 2
  call "Quick Scale 1D.gvi"(X=w17) -> (max|X|=w19)
  call "AM.gvi"(mu=$"Modulation index 2", mp=w19, m=w17, A=w18, fc=$"Subcarrier frequency 2") -> (G=w20)
  Add(w14, w20) -> w21
  call "Quick Scale 1D.gvi"(X=w21) -> (Y[i]=X[i]/Max|X|=w22)
  $"Baseband Signal" <- w22
  Real And Imaginary To Complex(x=w22, y=0) -> w23
  while (after c128[] []) {
    call "niUSRP Write Tx Data (CDB).gvi"(session handle=w3, error in=w4, data=w23, timeout=60, end of data?=$stop) -> (session handle out=w24, error out=w25)
    Logical Or(w25, $stop) -> w26
    stop if w26
  }
  call "niUSRP Close Session.gvi"(session handle=w24, error in=w25) -> (error out=w27)
  call "Simple Error Handler.gvi"(error in=w27) -> (error out=w28)
  $"error out" <- w28
  $"actual IQ rate" <- w5
  $"actual carrier frequency" <- w6
  $"actual gain (dB)" <- w7
