vi "Lab3TxTemplate.gvi"   [LabVIEW NXG 3.0.0]
panel controls:
  "IQ rate": f64 = 2000000
  "carrier frequency": f64 = 915000000
  "gain (dB)": f64
  "active antenna": string = "TX1"
  "message length (samples)": f64 = 200000
  "start frequency 1": f64 = 100
  "delta frequency 1": f64 = 100
  "#tones 1": i32 = 3
  "start frequency 2": f64 = 1000
  "delta frequency 2": f64 = 1000
  "#tones 2": i32 = 3
  "Device names": string
  "stop": bool
panel indicators:
  "actual IQ rate": f64
  "actual carrier frequency": f64
  "actual gain (dB)": f64
  "error out": error
  "Message": waveform<f64>
  "Baseband Signal": c128[]
uses:
  NI::USRP::niUSRP Open Tx Session.gvi
  NI::USRP::niUSRP Configure Signal.gvi
  NI::USRP::niUSRP Write Tx Data (CDB).gvi
  NI::USRP::niUSRP Close Session.gvi
  NI::G Core::Error::Legacy::Simple Error Handler.gvi
diagram:
  call "niUSRP Open Tx Session.gvi"(device names=$"Device names") -> (session handle out=w1, error out=w2)
  call "niUSRP Configure Signal.gvi"(active antenna=$"active antenna", session handle=w1, error in=w2, IQ rate=$"IQ rate", carrier frequency=$"carrier frequency", gain=$"gain (dB)") -> (session handle out=w3, error out=w4, coerced IQ rate=w5, coerced carrier frequency=w6, coerced gain=w7)
  Property Node(instance in=cluster{"Fs": f64, "#s": f64} {"Fs"=1000, "#s"=1000}, "#s"=$"message length (samples)", "Fs"=w5) -> (instance out=w8)
  w9 = FALSE  # coerce frequencies
  call "Basic Multitone.gvi"(sampling info=w8, coerce frequencies?=w9, phase relationship="random", start frequency=$"start frequency 2", delta frequency=$"delta frequency 2", #tones=$"#tones 2", amplitude=1) -> (signal out=w10)
  call "Quick Scale 1D.gvi"(X=w10) -> (max|X|=w11)
  call "lap3_fu.gvi"(m=w10, mp=w11, frequency=510000, u=1, A=5) -> (G=w12)
  w13 = TRUE  # coerce frequencies
  call "Basic Multitone.gvi"(sampling info=w8, coerce frequencies?=w13, phase relationship="random", start frequency=$"start frequency 1", delta frequency=$"delta frequency 1", #tones=$"#tones 1", amplitude=1) -> (signal out=w14)
  call "Quick Scale 1D.gvi"(X=w14) -> (max|X|=w15)
  call "lap3_fu.gvi"(m=w14, mp=w15, frequency=500000, u=1, A=5) -> (G=w16)
  Add(w16, w12) -> w17
  call "Quick Scale 1D.gvi"(X=w17) -> (Y[i]=X[i]/Max|X|=w18)
  Real And Imaginary To Complex(x=w18, y=[0]) -> w19
  $"Baseband Signal" <- w19
  while {
    call "niUSRP Write Tx Data (CDB).gvi"(session handle=w3, error in=w4, data=w19, timeout=60, end of data?=$stop) -> (session handle out=w20, error out=w21)
    Logical Or(w21, $stop) -> w22
    stop if w22
  }
  call "niUSRP Close Session.gvi"(session handle=w20, error in=w21) -> (error out=w23)
  call "Simple Error Handler.gvi"(error in=w23) -> (error out=w24)
  $"error out" <- w24
  $Message <- w10
  $"actual IQ rate" <- w5
  $"actual carrier frequency" <- w6
  $"actual gain (dB)" <- w7
