vi "lap3_fu.gvi"   [LabVIEW NXG 3.0.0]
inputs:
  "m": f64[]
  "mp": f64
  "frequency": f64 = 10
  "u": f64
  "A": f64
outputs:
  "G": f64[]
panel indicators:
  "Graph": f64[]
uses:
  NI::Analysis::Generation::Sine Wave (Scalar DBL).gvi
diagram:
  call "Sine Wave (Scalar DBL).gvi"(amplitude=1, frequency=$frequency, phase in=90) -> (sine wave=w1)
  Multiply($u, $m) -> w2
  Divide(x=w2, y=$mp) -> w3
  Add(w3, 1) -> w4
  Multiply(w4, $A) -> w5
  Multiply(w5, w1) -> w6
  $G <- w6
  $Graph <- w6
