vi "ChebyshevHilbert.gvi"   [LabVIEW NXG 3.0.0]
inputs:
  "input": c128[]
  "sampling freq: fs": f64 = 1000000
  "high cutoff freq: fh": f64 = 105000
  "low cutoff freq: fl": f64 = 95000
  "ripple(dB)": f64 = 0.1
  "init/cont (init:F)": bool
  "order": i32 = 5
outputs:
  "output": c128[]
uses:
  NI::Analysis::Transforms::Fast Hilbert Transform.gvi
diagram:
  call "Chebyshev Filter (CDB).gvi"(ripple(dB)=$"ripple(dB)", order=$order, init/cont (init:F)=$"init/cont (init:F)", X=$input, sampling freq: fs=$"sampling freq: fs", high cutoff freq: fh=$"high cutoff freq: fh", low cutoff freq: fl=$"low cutoff freq: fl", filter type="Bandpass") -> (Filtered X=w1)
  Complex To Real Imaginary(x + iy=w1) -> (x=w2, y=w3)
  call "Fast Hilbert Transform.gvi"(x=w2) -> (Hilbert{x}=w4, error out=w5)
  Property Node(instance in=w5)
  call "Fast Hilbert Transform.gvi"(x=w3) -> (Hilbert{x}=w6, error out=w7)
  call "Lab4_Operators.gvi"(xr=w2, xi=w3, xrh=w4, xih=w6) -> (y=w8)
  $output <- w8
  Property Node(instance in=w7)
