vi "Lab4Rx.gvi"   [LabVIEW NXG 3.0.0]
panel controls:
  "IQ rate": f64 = 1000000
  "carrier frequency": f64 = 915000000
  "gain (dB)": f64
  "active antenna": string = "RX2"
  "number of samples": i64 = 200000
  "Device names": string
  "stop": bool
panel indicators:
  "actual IQ rate": f64
  "actual carrier frequency": f64
  "actual gain (dB)": f64
  "error out": error
  "Baseband Output": f64[]
  "Power Spectrum": T1
types:
  T1 = cluster{"f0": f64, "df": f64, "magnitude": f64[]}
uses:
  NI::USRP::niUSRP Open Rx Session.gvi
  NI::USRP::niUSRP Configure Signal.gvi
  NI::USRP::niUSRP Initiate.gvi
  NI::USRP::niUSRP Fetch Rx Data (CDB WDT).gvi
  NI::USRP::niUSRP Abort.gvi
  NI::USRP::niUSRP Close Session.gvi
  NI::G Core::Error::Legacy::Simple Error Handler.gvi
diagram:
  call "niUSRP Open Rx Session.gvi"(device names=$"Device names") -> (session handle out=w1, error out=w2)
  call "niUSRP Configure Signal.gvi"(active antenna=$"active antenna", session handle=w1, error in=w2, IQ rate=$"IQ rate", carrier frequency=$"carrier frequency", gain=$"gain (dB)") -> (session handle out=w3, error out=w4, coerced IQ rate=w5, coerced carrier frequency=w6, coerced gain=w7)
  call "niUSRP Initiate.gvi"(session handle=w3, error in=w4) -> (session handle out=w8, error out=w9)
  w10 = $"number of samples"
  while {
    # data with intermediate fre.
    call "niUSRP Fetch Rx Data (CDB WDT).gvi"(session handle=w8, error in=w9, number of samples=w10, timeout=50) -> (session handle out=w11, error out=w12, data=w13)
    Property Node(instance in=w13) -> ("Y"=w14, "dt"=w15)  # Complex waveform properties
    call "ChebyshevHilbert.gvi"(input=w14, sampling freq: fs=w5, high cutoff freq: fh=105000, low cutoff freq: fl=95000) -> (output=w16)
    Complex To Real Imaginary(x + iy=w16) -> (x=w17)
    call "Butterworth Filter (DBL).gvi"(X=w17, sampling freq: fs=w5, high cutoff freq: fh=2500, low cutoff freq: fl=0) -> (Filtered X=w18)
    $"Baseband Output" <- w18
    w19 = cluster{"t0": timestamp, "dt": f64, "Y": c128[]} {all zero or empty}
    Property Node(instance in=w19, "Y"=w16, "dt"=w15) -> (instance out=w20)
    call "FFT Power Spectrum for 1 Chan (CDB)2.gvi"(time signal=w20, dB On (F)=TRUE) -> (power spectrum=w21)
    $"Power Spectrum" <- w21
    Logical Or(w12, $stop) -> w22
    stop if w22
  }
  call "niUSRP Abort.gvi"(session handle=w11, error in=w12) -> (session handle out=w23, error out=w24)
  call "niUSRP Close Session.gvi"(session handle=w23, error in=w24) -> (error out=w25)
  call "Simple Error Handler.gvi"(error in=w25) -> (error out=w26)
  $"error out" <- w26
  $"actual IQ rate" <- w5
  $"actual carrier frequency" <- w6
  $"actual gain (dB)" <- w7
