vi "Lab4Tx.gvi"   [LabVIEW NXG 3.0.0]
panel controls:
  "IQ rate": f64 = 200000
  "carrier frequency": f64 = 915100000
  "gain (dB)": f64
  "active antenna": string = "TX1"
  "message length (samples)": f64 = 200000
  "start frequency": f64 = 1000
  "delta frequency": f64 = 1000
  "#tones": i32 = 3
  "Device names": string = "192.168.10.2"
  "stop": bool
  "modulation index": f64
  "sub carrier frequency": f64
  "Amplitude": f64
panel indicators:
  "actual IQ rate": f64
  "actual carrier frequency": f64
  "actual gain (dB)": f64
  "error out": error
  "Message": waveform<f64>
  "output waveform": waveform<f64>
uses:
  NI::USRP::niUSRP Open Tx Session.gvi
  NI::USRP::niUSRP Configure Signal.gvi
  NI::USRP::niUSRP Write Tx Data (CDB).gvi
  NI::USRP::niUSRP Close Session.gvi
  NI::G Core::Error::Legacy::Simple Error Handler.gvi
diagram:
  call "niUSRP Open Tx Session.gvi"(device names=$"Device names") -> (session handle out=w1, error out=w2)
  call "niUSRP Configure Signal.gvi"(active antenna=$"active antenna", session handle=w1, error in=w2, IQ rate=$"IQ rate", carrier frequency=$"carrier frequency", gain=$"gain (dB)") -> (session handle out=w3, error out=w4, coerced IQ rate=w5, coerced carrier frequency=w6, coerced gain=w7)
  Property Node(instance in=cluster{"Fs": f64, "#s": f64} {"Fs"=1000, "#s"=1000}, "#s"=$"message length (samples)", "Fs"=w5) -> (instance out=w8)
  w9 = 1  # Amplitude
  w10 = FALSE  # coerce frequencies
  call "Basic Multitone.gvi"(sampling info=w8, coerce frequencies?=w10, start frequency=$"start frequency", delta frequency=$"delta frequency", #tones=$"#tones", amplitude=w9) -> (signal out=w11)
  $Message <- w11
  Property Node(instance in=w11) -> ("Y"=w12)
  call "Quick Scale 1D.gvi"(X=w12) -> (max|X|=w13)
  # data
  call "AM.gvi"(mu=$"modulation index", mp=w13, m=w12, A=$Amplitude, fc=$"sub carrier frequency") -> (G=w14)
  Build Waveform Node(Y=w14) -> (output waveform=w15)
  $"output waveform" <- w15
  while {
    call "niUSRP Write Tx Data (CDB).gvi"(session handle=w3, error in=w4, data=w14, end of data?=$stop) -> (session handle out=w16, error out=w17)
    Logical Or(w17, $stop) -> w18
    stop if w18
  }
  call "niUSRP Close Session.gvi"(session handle=w16, error in=w17) -> (error out=w19)
  call "Simple Error Handler.gvi"(error in=w19) -> (error out=w20)
  $"error out" <- w20
  $"actual IQ rate" <- w5
  $"actual carrier frequency" <- w6
  $"actual gain (dB)" <- w7
