vi "Lab5Rx.gvi"   [LabVIEW NXG 3.0.0]
panel controls:
  "IQ rate": f64 = 200000
  "carrier frequency": f64 = 915000000
  "gain (dB)": f64
  "active antenna": string = "RX2"
  "number of samples": i64 = 200000
  "Device names": string
  "stop": bool
panel indicators:
  "actual IQ rate": f64
  "actual carrier frequency": f64
  "actual gain (dB)": f64
  "error out": error
  "Demodulated Output": waveform<c128>
  "Graph": f64[]
  "Power Spectrum": T1
types:
  T1 = cluster{"f0": f64, "df": f64, "magnitude": f64[]}
uses:
  NI::USRP::niUSRP Open Rx Session.gvi
  NI::USRP::niUSRP Configure Signal.gvi
  NI::USRP::niUSRP Initiate.gvi
  NI::USRP::niUSRP Fetch Rx Data (CDB WDT).gvi
  NI::Analysis::Conditioning::Unwrap Phase.gvi
  NI::USRP::niUSRP Abort.gvi
  NI::USRP::niUSRP Close Session.gvi
  NI::G Core::Error::Legacy::Simple Error Handler.gvi
diagram:
  call "niUSRP Open Rx Session.gvi"(device names=$"Device names") -> (session handle out=w1, error out=w2)
  call "niUSRP Configure Signal.gvi"(active antenna=$"active antenna", session handle=w1, error in=w2, IQ rate=$"IQ rate", carrier frequency=$"carrier frequency", gain=$"gain (dB)") -> (session handle out=w3, error out=w4, coerced IQ rate=w5, coerced carrier frequency=w6, coerced gain=w7)
  call "niUSRP Initiate.gvi"(session handle=w3, error in=w4) -> (session handle out=w8, error out=w9)
  while {
    call "niUSRP Fetch Rx Data (CDB WDT).gvi"(session handle=w8, error in=w9, number of samples=$"number of samples") -> (session handle out=w10, error out=w11, data=w12)
    Property Node(instance in=w12) -> ("Y"=w13, "dt"=w14)
    Square(x=w13) -> w15
    Complex To Polar(r * e^(i*theta)=w15) -> (theta=w16)
    call "Median Filter2.gvi"(X=w16) -> (Filtered X=w17)
    call "Unwrap Phase.gvi"(input phase=w17) -> (unwrapped phase=w18, error out=w19)
    Merge Errors(w11, w19) -> (error out=w20)
    Logical Or(w20, $stop) -> w21
    Divide(x=w18, y=2) -> w22
    Polar To Complex(r=1, theta=w22) -> (r * e^(i*theta)=w23)
    Complex Conjugate(x + iy=w23) -> w24
    Multiply(w13, w24) -> w25
    Build Waveform Node(Y=w25, dt=w14) -> (output waveform=w26)
    $"Demodulated Output" <- w26
    w27 = cluster{"t0": timestamp, "dt": f64, "Y": c128[]} {all zero or empty}
    Property Node(instance in=w27, "Y"=w25, "dt"=w14) -> (instance out=w28)
    call "FFT Power Spectrum for 1 Chan (CDB)2.gvi"(time signal=w28) -> (power spectrum=w29)
    $"Power Spectrum" <- w29
    Complex To Real Imaginary(x + iy=w25) -> (x=w30)
    $Graph <- w30
    stop if w21
  }
  call "niUSRP Abort.gvi"(session handle=w10, error in=w20) -> (session handle out=w31, error out=w32)
  call "niUSRP Close Session.gvi"(session handle=w31, error in=w32) -> (error out=w33)
  call "Simple Error Handler.gvi"(error in=w33) -> (error out=w34)
  $"error out" <- w34
  $"actual IQ rate" <- w5
  $"actual carrier frequency" <- w6
  $"actual gain (dB)" <- w7
