vi "Lab5Tx.gvi"   [LabVIEW NXG 3.0.0]
panel controls:
  "IQ rate": f64 = 200000
  "carrier frequency": f64 = 915000000
  "gain (dB)": f64
  "active antenna": string = "TX1"
  "message length (samples)": f64 = 200000
  "start frequency": f64 = 1000
  "delta frequency": f64 = 1000
  "#tones": i32 = 3
  "Device names": string
  "stop": bool
panel indicators:
  "actual IQ rate": f64
  "actual carrier frequency": f64
  "actual gain (dB)": f64
  "error out": error
  "Message": waveform<f64>
  "Power Spectrum": T1
types:
  T1 = cluster{"f0": f64, "df": f64, "magnitude": f64[]}
uses:
  NI::USRP::niUSRP Open Tx Session.gvi
  NI::USRP::niUSRP Configure Signal.gvi
  NI::USRP::niUSRP Write Tx Data (CDB).gvi
  NI::USRP::niUSRP Close Session.gvi
  NI::G Core::Error::Legacy::Simple Error Handler.gvi
diagram:
  call "niUSRP Open Tx Session.gvi"(device names=$"Device names") -> (session handle out=w1, error out=w2)
  call "niUSRP Configure Signal.gvi"(active antenna=$"active antenna", session handle=w1, error in=w2, IQ rate=$"IQ rate", carrier frequency=$"carrier frequency", gain=$"gain (dB)") -> (session handle out=w3, error out=w4, coerced IQ rate=w5, coerced carrier frequency=w6, coerced gain=w7)
  Property Node(instance in=cluster{"Fs": f64, "#s": f64} {"Fs"=1000, "#s"=1000}, "#s"=$"message length (samples)", "Fs"=w5) -> (instance out=w8)
  w9 = TRUE  # coerce frequencies
  call "Basic Multitone.gvi"(sampling info=w8, coerce frequencies?=w9, start frequency=$"start frequency", seed=1, delta frequency=$"delta frequency", #tones=$"#tones", amplitude=1) -> (signal out=w10)
  $Message <- w10
  Property Node(instance in=w10) -> ("Y"=w11)
  call "Quick Scale 1D.gvi"(X=w11) -> (Y[i]=X[i]/Max|X|=w12)
  Multiply(w12, 1) -> w13
  Add(w13, [1]) -> w14
  call "Quick Scale 1D.gvi"(X=w14) -> (Y[i]=X[i]/Max|X|=w15)
  w16 = cluster{"t0": timestamp, "dt": f64, "Y": c128[]} {all zero or empty}
  Property Node(instance in=w16, "Y"=w15, "dt"=w5) -> (instance out=w17)
  call "FFT Power Spectrum for 1 Chan (CDB)2.gvi"(time signal=w17) -> (power spectrum=w18)
  $"Power Spectrum" <- w18
  Real And Imaginary To Complex(x=w15, y=f64[] []) -> w19
  while {
    call "niUSRP Write Tx Data (CDB).gvi"(session handle=w3, error in=w4, data=w19, end of data?=$stop) -> (session handle out=w20, error out=w21)
    Logical Or(w21, $stop) -> w22
    stop if w22
  }
  call "niUSRP Close Session.gvi"(session handle=w20, error in=w21) -> (error out=w23)
  call "Simple Error Handler.gvi"(error in=w23) -> (error out=w24)
  $"error out" <- w24
  $"actual IQ rate" <- w5
  $"actual carrier frequency" <- w6
  $"actual gain (dB)" <- w7
