vi "Lab6Rx.gvi"   [LabVIEW NXG 3.0.0]
panel controls:
  "IQ rate": f64 = 1000000
  "carrier frequency": f64 = 915000000
  "gain (dB)": f64
  "active antenna": string = "RX2"
  "number of samples": i64 = 200000
  "stop": bool
  "Device names": string
panel indicators:
  "actual IQ rate": f64
  "actual carrier frequency": f64
  "actual gain (dB)": f64
  "error out": error
  "Baseband Output": waveform<f64>
  "Output Spectrum": T1
types:
  T1 = cluster{"f0": f64, "df": f64, "magnitude": f64[]}
  "Filter Structure.gtype" = u32
  "Filter.gtype" = cluster{"filter structure": "Filter Structure.gtype", "forward coefficients": f64[], "reverse coefficients": f64[], "sampling frequency": f64}
uses:
  NI::USRP::niUSRP Open Rx Session.gvi
  NI::USRP::niUSRP Configure Signal.gvi
  NI::USRP::niUSRP Initiate.gvi
  NI::USRP::niUSRP Fetch Rx Data (CDB WDT).gvi
  NI::Analysis::Conditioning::Unwrap Phase.gvi
  NI::Analysis::Filtering::Filtering (DBL).gvi
  NI::Analysis::Measurement::Power Spectrum for 1 Chan.gvi
  NI::USRP::niUSRP Abort.gvi
  NI::USRP::niUSRP Close Session.gvi
  NI::G Core::Error::Legacy::Simple Error Handler.gvi
diagram:
  call "niUSRP Open Rx Session.gvi"(device names=$"Device names") -> (session handle out=w1, error out=w2)
  call "niUSRP Configure Signal.gvi"(active antenna=$"active antenna", session handle=w1, error in=w2, IQ rate=$"IQ rate", carrier frequency=$"carrier frequency", gain=$"gain (dB)") -> (session handle out=w3, error out=w4, coerced IQ rate=w5, coerced carrier frequency=w6, coerced gain=w7)
  call "niUSRP Initiate.gvi"(session handle=w3, error in=w4) -> (session handle out=w8, error out=w9)
  w10 = $"number of samples"
  while {
    call "niUSRP Fetch Rx Data (CDB WDT).gvi"(session handle=w8, error in=w9, number of samples=w10) -> (session handle out=w11, error out=w12, data=w13)
    Logical Or(w12, $stop) -> w14
    Property Node(instance in=w13) -> ("Y"=w15, "dt"=w16)
    Complex To Polar(r * e^(i*theta)=w15) -> (theta=w17)
    call "Unwrap Phase.gvi"(input phase=w17) -> (unwrapped phase=w18)
    w19 = "Filter.gtype" {"filter structure"=3, "forward coefficients"=[1], "reverse coefficients"=[1, -1], "sampling frequency"=0}
    call "Filtering (DBL).gvi"(signal=w18, filter=w19) -> (filtered signal=w20)
    Reciprocal(x=w16) -> w21
    call "Butterworth Filter (DBL).gvi"(X=w20, sampling freq: fs=w21, low cutoff freq: fl=50000) -> (Filtered X=w22)
    Build Waveform Node(Y=w22, dt=w16) -> (output waveform=w23)
    $"Baseband Output" <- w23
    call "Power Spectrum for 1 Chan.gvi"(signal=w23, dB on=TRUE) -> (power spectrum=w24)
    $"Output Spectrum" <- w24
    w25 = cluster{"t0": timestamp, "dt": f64, "Y": c128[]} {all zero or empty}
    Property Node(instance in=w25, "Y"=w22, "dt"=w16)
    stop if w14
  }
  call "niUSRP Abort.gvi"(session handle=w11, error in=w12) -> (session handle out=w26, error out=w27)
  call "niUSRP Close Session.gvi"(session handle=w26, error in=w27) -> (error out=w28)
  call "Simple Error Handler.gvi"(error in=w28) -> (error out=w29)
  $"error out" <- w29
  $"actual IQ rate" <- w5
  $"actual carrier frequency" <- w6
  $"actual gain (dB)" <- w7
