vi "Lab6Tx.gvi"   [LabVIEW NXG 3.0.0]
panel controls:
  "IQ rate": f64 = 1000000
  "carrier frequency": f64 = 915000000
  "gain (dB)": f64
  "active antenna": string = "TX1"
  "message length (samples)": f64 = 200000
  "start frequency": f64 = 1000
  "delta frequency": f64 = 1000
  "#tones": i32 = 3
  "Peak deviation (Hz)": f64 = 30000
  "stop": bool
  "Device names": string
panel indicators:
  "actual IQ rate": f64
  "actual carrier frequency": f64
  "actual gain (dB)": f64
  "error out": error
  "Message": waveform<f64>
  "Graph": waveform<c128>
types:
  "Filter Structure.gtype" = u32
  "Filter.gtype" = cluster{"filter structure": "Filter Structure.gtype", "forward coefficients": f64[], "reverse coefficients": f64[], "sampling frequency": f64}
uses:
  NI::USRP::niUSRP Open Tx Session.gvi
  NI::USRP::niUSRP Configure Signal.gvi
  NI::Analysis::Filtering::Filtering (DBL).gvi
  NI::USRP::niUSRP Write Tx Data (CDB).gvi
  NI::USRP::niUSRP Close Session.gvi
  NI::G Core::Error::Legacy::Simple Error Handler.gvi
diagram:
  call "niUSRP Open Tx Session.gvi"(device names=$"Device names") -> (session handle out=w1, error out=w2)
  call "niUSRP Configure Signal.gvi"(active antenna=$"active antenna", session handle=w1, error in=w2, IQ rate=$"IQ rate", carrier frequency=$"carrier frequency", gain=$"gain (dB)") -> (session handle out=w3, error out=w4, coerced IQ rate=w5, coerced carrier frequency=w6, coerced gain=w7)
  w8 = TRUE  # coerce frequencies
  Property Node(instance in=cluster{"Fs": f64, "#s": f64} {"Fs"=1000, "#s"=1000}, "Fs"=w5, "#s"=$"message length (samples)") -> (instance out=w9)
  call "Basic Multitone.gvi"(sampling info=w9, coerce frequencies?=w8, start frequency=$"start frequency", delta frequency=$"delta frequency", #tones=$"#tones", amplitude=1) -> (signal out=w10)
  Property Node(instance in=w10) -> ("Y"=w11, "dt"=w12)
  Multiply($"Peak deviation (Hz)", 6.28318530718) -> w13
  Multiply(w13, w12) -> w14
  while {
    w15 = "Filter.gtype" {"filter structure"=2, "forward coefficients"=[1], "reverse coefficients"=[-1], "sampling frequency"=0}
    # peak freq. deviation
    call "Filtering (DBL).gvi"(signal=w11, filter=w15, condition in=cluster{"condition": f64[]} {"condition"=[1]}, error in=w4) -> (filtered signal=w16, error out=w17)
    Multiply(w14, w16) -> w18
    Polar To Complex(r=0.9, theta=w18) -> (r * e^(i*theta)=w19)
    Merge Errors(w4, w17) -> (error out=w20)
    call "niUSRP Write Tx Data (CDB).gvi"(session handle=w3, error in=w20, data=w19, end of data?=$stop) -> (session handle out=w21, error out=w22)
    Logical Or(w22, $stop) -> w23
    Build Waveform Node(Y=w19, dt=w12) -> (output waveform=w24)
    $Graph <- w24
    w25 = cluster{"dt": f64, "Y": c128[], "t0": f64} {all zero or empty}
    Property Node(instance in=w25, "t0"=0, "Y"=w19, "dt"=w12)
    stop if w23
  }
  call "niUSRP Close Session.gvi"(session handle=w21, error in=w22) -> (error out=w26)
  call "Simple Error Handler.gvi"(error in=w26) -> (error out=w27)
  $"error out" <- w27
  $"actual IQ rate" <- w5
  $"actual carrier frequency" <- w6
  $Message <- w10
  $"actual gain (dB)" <- w7
