vi "ASKRx.gvi"   [LabVIEW NXG 3.0.0]
panel controls:
  "IQ rate": f64 = 1000000
  "carrier frequency": f64 = 915000000
  "gain (dB)": f64
  "active antenna": string = "RX2"
  "message length (bits)": i64 = 1000
  "symbol rate (sym/s)": i64 = 10000
  "Device names": string
panel indicators:
  "actual IQ rate": f64
  "actual carrier frequency": f64
  "actual gain (dB)": f64
  "error out": error
  "trigger found?": bool
  "Baseband Output": cluster{"t0": f64, "dt": f64, "Y": f64[]}
  "Eye Diagram": cluster{"t0": f64, "dt": f64, "Y": f64[]}[]
  "samples per symbol": f64
  "BER": f64
  "output bits": i16[]
  "product": f64
uses:
  NI::USRP::niUSRP Open Rx Session.gvi
  NI::USRP::niUSRP Configure Signal.gvi
  NI::USRP::niUSRP Initiate.gvi
  NI::USRP::niUSRP Fetch Rx Data (CDB Cluster).gvi
  NI::Analysis::Resampling::Decimate (single shot, DBL).gvi
  NI::USRP::niUSRP Abort.gvi
  NI::USRP::niUSRP Close Session.gvi
  NI::G Core::Error::Legacy::Simple Error Handler.gvi
  NI::Modulation::MT Calculate BER After Trigger (Fibonacci PN Sequence).gvi
  NI::Modulation::MT Format Eye Diagram (WDT).gvi
diagram:
  call "niUSRP Open Rx Session.gvi"(device names=$"Device names") -> (session handle out=w1, error out=w2)
  call "niUSRP Configure Signal.gvi"(active antenna=$"active antenna", session handle=w1, error in=w2, IQ rate=$"IQ rate", carrier frequency=$"carrier frequency", gain=$"gain (dB)") -> (session handle out=w3, error out=w4, coerced IQ rate=w5, coerced carrier frequency=w6, coerced gain=w7)
  call "niUSRP Initiate.gvi"(session handle=w3, error in=w4) -> (session handle out=w8, error out=w9)
  # no. samples
  # samples/symbol
  Divide(x=w5, y=$"symbol rate (sym/s)") -> w10
  Multiply($"message length (bits)", w10) -> w11
  call "niUSRP Fetch Rx Data (CDB Cluster).gvi"(session handle=w8, error in=w9, number of samples=w11) -> (session handle out=w12, error out=w13, data=w14)
  # number of samples
  Property Node(instance in=w14) -> ("dt"=w15, "Y"=w16)
  call "Chebyshev Filter (CDB).gvi"(X=w16, sampling freq: fs=w5, high cutoff freq: fh=110000, low cutoff freq: fl=90000) -> (Filtered X=w17)
  Complex To Real Imaginary(x + iy=w17) -> (x=w18)
  w19 = cluster{"t0": f64, "dt": f64, "Y": f64[]} {all zero or empty}
  Property Node(instance in=w19, "dt"=w15, "Y"=w18) -> (instance out=w20)  # Cluster Properties
  $"Baseband Output" <- w20
  call "Mean DBL.gvi"(X=w18) -> (mean=w21)
  call "PulseAlign(real).gvi"(Input Signal=w20, Receiver Sampling Factor=w10) -> (Aligned Signal=w22)
  Property Node(instance in=w22) -> ("Y"=w23)
  call "Decimate (single shot, DBL).gvi"(signal=w23, decimating factor=w10) -> (decimated signal=w24)
  call "FrameSync(Real).gvi"(Sampled Input=w24) -> (Aligned Samples=w25)
  Is Less Or Equal(x=w25, y=w21) -> w26
  Boolean To Integer(Boolean=w26) -> (0, 1=w27)
  # BER
  $"output bits" <- w27
  call "niUSRP Abort.gvi"(session handle=w12, error in=w13) -> (session handle out=w28, error out=w29)
  call "niUSRP Close Session.gvi"(session handle=w28, error in=w29) -> (error out=w30)
  call "Simple Error Handler.gvi"(error in=w30) -> (error out=w31)
  $"error out" <- w31
  Array Subset(array=w27, index0=0, length0=$"message length (bits)") -> w32
  call "MT Calculate BER After Trigger (Fibonacci PN Sequence).gvi"(input bit stream=w32, BER trigger threshold=0.4) -> (BER=w33, trigger found?=w34)
  $BER <- w33
  $"actual IQ rate" <- w5
  $"trigger found?" <- w34
  Build Waveform Node(Y=w18, dt=w15) -> (output waveform=w35)
  call "MT Format Eye Diagram (WDT).gvi"(waveform=w35, symbol rate=$"symbol rate (sym/s)", eye length=2) -> (eye diagram=w36)
  $"Eye Diagram" <- w36
  $"actual carrier frequency" <- w6
  $"actual gain (dB)" <- w7
  $product <- w11
  $"samples per symbol" <- w10
