vi "ASKTx.gvi"   [LabVIEW NXG 3.0.0]
panel controls:
  "IQ rate": f64 = 200000
  "carrier frequency": f64 = 915100000
  "gain (dB)": f64
  "active antenna": string = "TX1"
  "message length (bits)": i32 = 1000
  "symbol rate (sym/s)": i32 = 10000
  "stop": bool
  "Device names": string
panel indicators:
  "actual IQ rate": f64
  "actual carrier frequency": f64
  "actual gain (dB)": f64
  "error out": error
  "Baseband Waveform": waveform<f64>
  "source bit stream": i8[]
  "Power Spectrum": T1
  "Polar Graph": f64[]
  "Graph": f64[]
types:
  T1 = cluster{"f0": f64, "df": f64, "magnitude": f64[]}
uses:
  NI::USRP::niUSRP Open Tx Session.gvi
  NI::USRP::niUSRP Configure Signal.gvi
  NI::Modulation::MT Generate Bits (Fibonacci, PN Order).gvi
  NI::Analysis::Conditioning::Map Table 1D.gvi
  NI::Analysis::Resampling::Upsample (DBL).gvi
  NI::Modulation::MT Generate Filter Coefficients.gvi
  NI::Analysis::Operations::1D Convolution (DBL).gvi
  NI::USRP::niUSRP Write Tx Data (CDB).gvi
  NI::USRP::niUSRP Close Session.gvi
  NI::G Core::Error::Legacy::Simple Error Handler.gvi
diagram:
  call "niUSRP Open Tx Session.gvi"(device names=$"Device names") -> (session handle out=w1, error out=w2)
  call "niUSRP Configure Signal.gvi"(active antenna=$"active antenna", session handle=w1, error in=w2, IQ rate=$"IQ rate", carrier frequency=$"carrier frequency", gain=$"gain (dB)") -> (session handle out=w3, error out=w4, coerced IQ rate=w5, coerced carrier frequency=w6, coerced gain=w7)
  # Symbol Mapping
  Divide(x=w5, y=$"symbol rate (sym/s)") -> w8
  call "MT Generate Bits (Fibonacci, PN Order).gvi"(total bits=$"message length (bits)", error in=w4) -> (output bit stream=w9)
  call "Map Table 1D.gvi"(signal=w9, table map=[[0, -1], [0, 1]]) -> (scaled signal=w10)
  call "AddFrameHeader(Real).gvi"(Array in=w10) -> (Array out=w11)
  # Upsampling
  call "Upsample (DBL).gvi"(signal=w11, upsampling factor=w8) -> (upsampled signal=w12)
  # Pulse Shaping
  call "MT Generate Filter Coefficients.gvi"(pulse shaping filter="none", pulse shaping samples per symbol=w8, modulation type="ASK") -> (pulse shaping filter coefficients=w13)
  call "1D Convolution (DBL).gvi"(x=w12, y=w13) -> (x * y=w14)
  Add(w14, 1) -> w15
  call "Quick Scale 1D.gvi"(X=w15) -> (Y[i]=X[i]/Max|X|=w16)
  while {
    call "niUSRP Write Tx Data (CDB).gvi"(session handle=w3, error in=w4, data=w16, end of data?=$stop) -> (session handle out=w17, error out=w18)
    Logical Or(w18, $stop) -> w19
    stop if w19
  }
  call "niUSRP Close Session.gvi"(session handle=w17, error in=w18) -> (error out=w20)
  call "Simple Error Handler.gvi"(error in=w20) -> (error out=w21)
  $"error out" <- w21
  $"actual IQ rate" <- w5
  $"Polar Graph" <- w16
  $"actual carrier frequency" <- w6
  $"actual gain (dB)" <- w7
  $Graph <- w16
  $"source bit stream" <- w9
  Complex To Real Imaginary(x + iy=w14) -> (x=w22)
  # Modulation
  Reciprocal(x=w5) -> w23
  w24 = cluster{"t0": timestamp, "dt": f64, "Y": c128[]} {all zero or empty}
  Property Node(instance in=w24, "Y"=w22, "dt"=w23) -> (instance out=w25)
  call "FFT Power Spectrum for 1 Chan (CDB)2.gvi"(time signal=w25) -> (power spectrum=w26)
  $"Power Spectrum" <- w26
  Build Waveform Node(Y=w22, dt=w23) -> (output waveform=w27)
  $"Baseband Waveform" <- w27
