vi "FSKRx.gvi"   [LabVIEW NXG 3.0.0]
panel controls:
  "IQ rate": f64 = 400000
  "carrier frequency": f64 = 915000000
  "gain (dB)": f64
  "active antenna": string = "RX2"
  "symbol rate (sym/s)": i64 = 10000
  "message length (bits)": i64 = 1000
  "Device names": string
panel indicators:
  "actual IQ rate": f64
  "actual carrier frequency": f64
  "actual gain (dB)": f64
  "error out": error
  "BER": f64
  "trigger found?": bool
  "Baseband Output": cluster{"t0": f64, "dt": f64, "Y": f64[]}
  "Eye Diagram": cluster{"t0": f64, "dt": f64, "Y": f64[]}[]
  "samples per symbol": f64
  "output waveform": waveform<f64>
  "output bits": i16[]
types:
  "Filter Structure.gtype" = u32
  "Filter.gtype" = cluster{"filter structure": "Filter Structure.gtype", "forward coefficients": f64[], "reverse coefficients": f64[], "sampling frequency": f64}
uses:
  NI::USRP::niUSRP Open Rx Session.gvi
  NI::USRP::niUSRP Configure Signal.gvi
  NI::USRP::niUSRP Initiate.gvi
  NI::USRP::niUSRP Fetch Rx Data (CDB Cluster).gvi
  NI::Analysis::Conditioning::Unwrap Phase.gvi
  NI::Analysis::Filtering::Filtering (DBL).gvi
  NI::Analysis::Filtering::Median Filter.gvi
  NI::Modulation::MT Generate Filter Coefficients.gvi
  NI::Analysis::Operations::1D Convolution (DBL).gvi
  NI::Analysis::Resampling::Decimate (single shot, DBL).gvi
  NI::USRP::niUSRP Abort.gvi
  NI::USRP::niUSRP Close Session.gvi
  NI::G Core::Error::Legacy::Simple Error Handler.gvi
  NI::Modulation::MT Calculate BER After Trigger (PN Sequence).gvi
  NI::Modulation::MT Format Eye Diagram (complex).gvi
diagram:
  call "niUSRP Open Rx Session.gvi"(device names=$"Device names") -> (session handle out=w1, error out=w2)
  call "niUSRP Configure Signal.gvi"(active antenna=$"active antenna", session handle=w1, error in=w2, IQ rate=$"IQ rate", carrier frequency=$"carrier frequency", gain=$"gain (dB)") -> (session handle out=w3, error out=w4, coerced IQ rate=w5, coerced carrier frequency=w6, coerced gain=w7)
  call "niUSRP Initiate.gvi"(session handle=w3, error in=w4) -> (session handle out=w8, error out=w9)
  # samples/symbol = Decimation Factor
  Divide(x=w5, y=$"symbol rate (sym/s)") -> w10
  Multiply(w10, $"message length (bits)") -> w11
  # get phase
  call "niUSRP Fetch Rx Data (CDB Cluster).gvi"(session handle=w8, error in=w9, number of samples=w11) -> (session handle out=w12, error out=w13, data=w14)
  # no. samples
  Property Node(instance in=w14) -> ("dt"=w15, "Y"=w16)
  Complex To Polar(r * e^(i*theta)=w16) -> (theta=w17)
  # unwrap
  call "Unwrap Phase.gvi"(input phase=w17) -> (unwrapped phase=w18)
  w19 = "Filter.gtype" {"filter structure"=3, "forward coefficients"=[1], "reverse coefficients"=[1, -1], "sampling frequency"=0}
  # differentiate
  call "Filtering (DBL).gvi"(signal=w18, filter=w19) -> (filtered signal=w20)
  # remove spikes
  call "Median Filter.gvi"(signal=w20, left rank=5) -> (filtered signal=w21)
  call "MT Generate Filter Coefficients.gvi"(pulse shaping filter="none", matched samples per symbol=w10, modulation type="FSK") -> (pulse shaping filter coefficients=w22)
  call "1D Convolution (DBL).gvi"(x=w21, y=w22) -> (x * y=w23)
  # matched filter
  w24 = cluster{"t0": f64, "dt": f64, "Y": f64[]} {all zero or empty}
  Property Node(instance in=w24, "dt"=w15, "Y"=w23) -> (instance out=w25)
  # pulse sync
  $"Baseband Output" <- w25
  # eye diagram
  # sample
  # frame sync
  Property Node(instance in=w25)
  call "PulseAlign(real).gvi"(Input Signal=w25, Receiver Sampling Factor=w10) -> (Aligned Signal=w26)
  Property Node(instance in=w26) -> ("Y"=w27, "t0"=w28)
  call "Decimate (single shot, DBL).gvi"(signal=w27, decimating factor=w10) -> (decimated signal=w29)
  Is Equal To 0(x=w29) -> w30
  Boolean To Integer(Boolean=w30) -> (0, 1=w31)
  # threshold & symbol mapping
  # BER
  $"output bits" <- w31
  call "niUSRP Abort.gvi"(session handle=w12, error in=w13) -> (session handle out=w32, error out=w33)
  call "niUSRP Close Session.gvi"(session handle=w32, error in=w33) -> (error out=w34)
  call "Simple Error Handler.gvi"(error in=w34) -> (error out=w35)
  $"error out" <- w35
  Array Subset(array=w31, index0=0, length0=$"message length (bits)") -> w36
  call "MT Calculate BER After Trigger (PN Sequence).gvi"(input bit stream=w36, BER trigger threshold=0.4) -> (BER=w37, trigger found?=w38)
  $BER <- w37
  $"actual IQ rate" <- w5
  $"trigger found?" <- w38
  $"actual carrier frequency" <- w6
  call "MT Format Eye Diagram (complex).gvi"(waveform=w25, symbol rate=$"symbol rate (sym/s)", eye length=2) -> (eye diagram=w39)
  $"Eye Diagram" <- w39
  $"actual gain (dB)" <- w7
  Build Waveform Node(Y=w27, dt=w28) -> (output waveform=w40)
  $"output waveform" <- w40
  $"samples per symbol" <- w10
