vi "FSKTx.gvi"   [LabVIEW NXG 3.0.0]
panel controls:
  "IQ rate": f64 = 400000
  "carrier frequency": f64 = 915000000
  "gain (dB)": f64
  "active antenna": string = "TX1"
  "message length (bits)": i32 = 1000
  "symbol rate (sym/s)": i32 = 10000
  "stop": bool
  "Device names": string
  "frequency deviation": f64
  "carrier amplitude": f64
panel indicators:
  "actual IQ rate": f64
  "actual carrier frequency": f64
  "actual gain (dB)": f64
  "error out": error
  "Message Waveform": waveform<c128>
  "source bit stream": i8[]
  "Baseband Power Spectrum": T1
types:
  T1 = cluster{"f0": f64, "df": f64, "magnitude": f64[]}
  "Filter Structure.gtype" = u32
  "Filter.gtype" = cluster{"filter structure": "Filter Structure.gtype", "forward coefficients": f64[], "reverse coefficients": f64[], "sampling frequency": f64}
uses:
  NI::USRP::niUSRP Open Tx Session.gvi
  NI::USRP::niUSRP Configure Signal.gvi
  NI::Modulation::MT Generate Bits (Fibonacci, PN Order).gvi
  NI::Analysis::Conditioning::Map Table 1D.gvi
  NI::Analysis::Resampling::Upsample (DBL).gvi
  NI::Modulation::MT Generate Filter Coefficients.gvi
  NI::Analysis::Operations::1D Convolution (DBL).gvi
  NI::Analysis::Filtering::Filtering (Waveform).gvi
  NI::USRP::niUSRP Write Tx Data (CDB WDT).gvi
  NI::USRP::niUSRP Close Session.gvi
  NI::G Core::Error::Legacy::Simple Error Handler.gvi
diagram:
  call "niUSRP Open Tx Session.gvi"(device names=$"Device names") -> (session handle out=w1, error out=w2)
  call "niUSRP Configure Signal.gvi"(active antenna=$"active antenna", session handle=w1, error in=w2, IQ rate=$"IQ rate", carrier frequency=$"carrier frequency", gain=$"gain (dB)") -> (session handle out=w3, error out=w4, coerced IQ rate=w5, coerced carrier frequency=w6, coerced gain=w7)
  Reciprocal(x=w5) -> w8
  # samples/symbol = upsample factor
  Divide(x=w5, y=$"symbol rate (sym/s)") -> w9
  call "MT Generate Bits (Fibonacci, PN Order).gvi"(total bits=$"message length (bits)", error in=w4) -> (output bit stream=w10)
  call "Map Table 1D.gvi"(signal=w10, table map=[[0, -1], [0, 1]]) -> (scaled signal=w11)
  call "Upsample (DBL).gvi"(signal=w11, upsampling factor=w9) -> (upsampled signal=w12)
  # Pulse Shaping
  # Upsampling
  call "MT Generate Filter Coefficients.gvi"(pulse shaping filter="none", pulse shaping samples per symbol=w9, modulation type="FSK") -> (pulse shaping filter coefficients=w13)
  call "1D Convolution (DBL).gvi"(x=w12, y=w13) -> (x * y=w14)
  # Modulation
  call "Quick Scale 1D.gvi"(X=w14) -> (Y[i]=X[i]/Max|X|=w15)
  Build Waveform Node(Y=w15, dt=w8) -> (output waveform=w16)
  w17 = "Filter.gtype" {"filter structure"=2, "forward coefficients"=[1], "reverse coefficients"=[1, -1], "sampling frequency"=0}
  call "Filtering (Waveform).gvi"(signal=w16, filter=w17) -> (filtered signal=w18)
  Property Node(instance in=w18) -> ("Y"=w19)
  Multiply($"frequency deviation", f64 default) -> w20
  Multiply(w20, w19) -> w21
  Polar To Complex(r=$"carrier amplitude", theta=w21) -> (r * e^(i*theta)=w22)
  Build Waveform Node(Y=w22, dt=w8) -> (output waveform=w23)
  w24 = cluster{"t0": timestamp, "dt": f64, "Y": c128[]} {all zero or empty}
  Property Node(instance in=w24, "Y"=w22, "dt"=w8) -> (instance out=w25)
  call "FFT Power Spectrum for 1 Chan (CDB)2.gvi"(time signal=w25, dB On (F)=TRUE) -> (power spectrum=w26, Error Out=w27)
  while {
    call "niUSRP Write Tx Data (CDB WDT).gvi"(session handle=w3, error in=w27, data=w23, end of data?=$stop) -> (session handle out=w28, error out=w29)
    Logical Or(w29, $stop) -> w30
    stop if w30
  }
  call "niUSRP Close Session.gvi"(session handle=w28, error in=w29) -> (error out=w31)
  call "Simple Error Handler.gvi"(error in=w31) -> (error out=w32)
  $"error out" <- w32
  $"source bit stream" <- w10
  $"actual IQ rate" <- w5
  $"actual carrier frequency" <- w6
  $"actual gain (dB)" <- w7
  $"Message Waveform" <- w23
  $"Baseband Power Spectrum" <- w26
