vi "BPSKRx.gvi"   [LabVIEW NXG 3.0.0]
panel controls:
  "IQ rate": f64 = 200000
  "carrier frequency": f64 = 915000000
  "gain (dB)": f64
  "active antenna": string = "RX2"
  "message length (bits)": i64 = 1000
  "symbol rate (sym/s)": i64 = 10000
  "Device names": string
panel indicators:
  "actual IQ rate": f64
  "actual carrier frequency": f64
  "actual gain (dB)": f64
  "error out": error
  "Output bits": i16[]
  "BER": f64
  "trigger found?": bool
  "Baseband Output": cluster{"t0": f64, "dt": f64, "Y": f64[]}
  "Eye Diagram": cluster{"t0": f64, "dt": f64, "Y": f64[]}[]
  "output waveform": waveform<f64>
uses:
  NI::USRP::niUSRP Open Rx Session.gvi
  NI::USRP::niUSRP Configure Signal.gvi
  NI::USRP::niUSRP Initiate.gvi
  NI::USRP::niUSRP Fetch Rx Data (CDB Cluster).gvi
  NI::Analysis::Filtering::Median Filter (Wfm DBL).gvi
  NI::Analysis::Conditioning::Unwrap Phase.gvi
  NI::Modulation::MT Generate Filter Coefficients.gvi
  NI::Analysis::Operations::1D Convolution (DBL).gvi
  NI::USRP::niUSRP Abort.gvi
  NI::USRP::niUSRP Close Session.gvi
  NI::G Core::Error::Legacy::Simple Error Handler.gvi
  NI::Analysis::Resampling::Decimate (single shot, DBL).gvi
  NI::Modulation::MT Format Eye Diagram (complex).gvi
diagram:
  call "niUSRP Open Rx Session.gvi"(device names=$"Device names") -> (session handle out=w1)
  call "niUSRP Configure Signal.gvi"(active antenna=$"active antenna", session handle=w1, IQ rate=$"IQ rate", carrier frequency=$"carrier frequency", gain=$"gain (dB)") -> (session handle out=w2, error out=w3, coerced IQ rate=w4, coerced carrier frequency=w5, coerced gain=w6)
  call "niUSRP Initiate.gvi"(session handle=w2, error in=w3) -> (session handle out=w7, error out=w8)
  # samples/symbol
  Divide(x=w4, y=$"symbol rate (sym/s)") -> w9
  # no. samples
  Multiply(w9, $"message length (bits)") -> w10
  Multiply(w10, 2) -> w11
  call "niUSRP Fetch Rx Data (CDB Cluster).gvi"(session handle=w7, error in=w8, number of samples=w11) -> (session handle out=w12, data=w13)
  # Estimate Phase
  Property Node(instance in=w13) -> ("dt"=w14, "Y"=w15)
  Square(x=w15) -> w16
  call "Median Filter (Wfm DBL).gvi"(signal=w16) -> (filtered signal=w17)
  Property Node(instance in=w17) -> ("Y"=w18)
  call "Unwrap Phase.gvi"(input phase=w18) -> (unwrapped phase=w19)
  Divide(x=w19, y=2) -> w20
  Polar To Complex(r=1, theta=w20) -> (r * e^(i*theta)=w21)
  Complex Conjugate(x + iy=w21) -> w22
  Multiply(w15, w22) -> w23
  Complex To Real Imaginary(x + iy=w23) -> (x=w24)
  # Demodulate
  call "MT Generate Filter Coefficients.gvi"(pulse shaping filter="Root Raised Cos", matched samples per symbol=w9, modulation type="PSK") -> (matched filter coefficients=w25)
  call "1D Convolution (DBL).gvi"(x=w24, y=w25) -> (x * y=w26)
  # Matched Filter
  w27 = cluster{"t0": f64, "dt": f64, "Y": f64[]} {all zero or empty}
  Property Node(instance in=w27, "dt"=w14, "Y"=w26) -> (instance out=w28)  # Cluster Properties
  # Pulse Sync
  $"Baseband Output" <- w28
  call "niUSRP Abort.gvi"(session handle=w12) -> (session handle out=w29, error out=w30)
  call "niUSRP Close Session.gvi"(session handle=w29, error in=w30) -> (error out=w31)
  call "Simple Error Handler.gvi"(error in=w31) -> (error out=w32)
  $"error out" <- w32
  call "PulseAlign(real).gvi"(Input Signal=w28, Receiver Sampling Factor=w9) -> (Aligned Signal=w33)
  Property Node(instance in=w33) -> ("Y"=w34, "dt"=w35)
  Build Waveform Node(Y=w34, dt=w35) -> (output waveform=w36)
  # Sample
  $"output waveform" <- w36
  # Frame Sync
  call "Decimate (single shot, DBL).gvi"(signal=w34, decimating factor=w9) -> (decimated signal=w37)
  # Detection & Symbol Mapping
  Is Equal To 0(x=w37) -> w38
  Boolean To Integer(Boolean=w38) -> (0, 1=w39)
  # BER
  $"Output bits" <- w39
  $"actual IQ rate" <- w4
  $"actual carrier frequency" <- w5
  $"actual gain (dB)" <- w6
  call "MT Format Eye Diagram (complex).gvi"(waveform=w28, symbol rate=$"symbol rate (sym/s)", eye length=2) -> (eye diagram=w40)
  $"Eye Diagram" <- w40
