vi "BPSKTx.gvi"   [LabVIEW NXG 3.0.0]
panel controls:
  "IQ rate": f64 = 200000
  "carrier frequency": f64 = 915000000
  "gain (dB)": f64
  "active antenna": string = "TX1"
  "message length (bits)": i32 = 1000
  "symbol rate (sym/s)": i32 = 10000
  "stop": bool
  "Device names": string
panel indicators:
  "actual IQ rate": f64
  "actual carrier frequency": f64
  "actual gain (dB)": f64
  "error out": error
  "source bit stream": i8[]
  "Baseband Waveform": waveform<f64>
  "Power Spectrum": T1
types:
  T1 = cluster{"f0": f64, "df": f64, "magnitude": f64[]}
uses:
  NI::USRP::niUSRP Open Tx Session.gvi
  NI::USRP::niUSRP Configure Signal.gvi
  NI::Modulation::MT Generate Bits (Fibonacci, PN Order).gvi
  NI::Analysis::Conditioning::Map Table 1D.gvi
  NI::Analysis::Resampling::Upsample (DBL).gvi
  NI::Modulation::MT Generate Filter Coefficients.gvi
  NI::Analysis::Operations::1D Convolution (DBL).gvi
  NI::USRP::niUSRP Write Tx Data (CDB WDT).gvi
  NI::USRP::niUSRP Close Session.gvi
  NI::G Core::Error::Legacy::Simple Error Handler.gvi
diagram:
  call "niUSRP Open Tx Session.gvi"(device names=$"Device names") -> (session handle out=w1, error out=w2)
  call "niUSRP Configure Signal.gvi"(active antenna=$"active antenna", session handle=w1, error in=w2, IQ rate=$"IQ rate", carrier frequency=$"carrier frequency", gain=$"gain (dB)") -> (session handle out=w3, error out=w4, coerced IQ rate=w5, coerced carrier frequency=w6, coerced gain=w7)
  # Upsampling Factor
  Divide(x=w5, y=$"symbol rate (sym/s)") -> w8
  call "MT Generate Bits (Fibonacci, PN Order).gvi"(total bits=$"message length (bits)", error in=w4) -> (output bit stream=w9)
  # Framing
  call "Map Table 1D.gvi"(signal=w9, table map=[[0, -1], [0, 1]]) -> (scaled signal=w10)
  # Upsampling
  call "Upsample (DBL).gvi"(signal=w10, upsampling factor=w8) -> (upsampled signal=w11)
  # Pulse Shaping
  call "MT Generate Filter Coefficients.gvi"(pulse shaping filter="Root Raised Cos", pulse shaping samples per symbol=w8, modulation type="PSK") -> (pulse shaping filter coefficients=w12)
  # Modulation
  call "1D Convolution (DBL).gvi"(x=w11, y=w12) -> (x * y=w13)
  call "Quick Scale 1D.gvi"(X=w13) -> (Y[i]=X[i]/Max|X|=w14)
  Reciprocal(x=w5) -> w15
  Build Waveform Node(Y=w14, dt=w15) -> (output waveform=w16)
  w17 = cluster{"t0": timestamp, "dt": f64, "Y": c128[]} {all zero or empty}
  Property Node(instance in=w17, "Y"=w14, "dt"=w15) -> (instance out=w18)
  call "FFT Power Spectrum for 1 Chan (CDB)2.gvi"(time signal=w18, dB On (F)=TRUE) -> (power spectrum=w19, Error Out=w20)
  while {
    call "niUSRP Write Tx Data (CDB WDT).gvi"(session handle=w3, error in=w20, data=w16, end of data?=$stop) -> (session handle out=w21, error out=w22)
    Logical Or(w22, $stop) -> w23
    stop if w23
  }
  call "niUSRP Close Session.gvi"(session handle=w21, error in=w22) -> (error out=w24)
  call "Simple Error Handler.gvi"(error in=w24) -> (error out=w25)
  $"error out" <- w25
  # Symbol Mapping
  $"source bit stream" <- w9
  $"Baseband Waveform" <- w16
  To Double Precision Float(number=w9)
  $"actual IQ rate" <- w5
  $"Power Spectrum" <- w19
  $"actual carrier frequency" <- w6
  $"actual gain (dB)" <- w7
