vi "Receiver_ASK,FSK,PSK.gvi"   [LabVIEW NXG 3.0.0]
panel controls:
  "device names": "USRP niUSRPClass"
  "IQ rate": f64 = 100000
  "carrier frequency": f64 = 100000
  "gain": f64
  "symbol rate": f64
  "message length": f64
  "active antenna": string
panel indicators:
  "coerced IQ rate": f64
  "coerced carrier frequency": f64
  "coerced gain": f64
  "Graph": cluster{"t0": f64, "dt": f64, "Y": c128[]}
  "Graph_2": f64[]
  "output bit stream": i8[]
  "error out": error
uses:
  NI::USRP::niUSRP Open Rx Session.gvi
  NI::USRP::niUSRP Configure Signal.gvi
  NI::USRP::niUSRP Initiate.gvi
  NI::USRP::niUSRP Fetch Rx Data (CDB Cluster).gvi
  NI::USRP::niUSRP Abort.gvi
  NI::USRP::niUSRP Close Session.gvi
  NI::G Core::Error::Legacy::Simple Error Handler.gvi
  NI::Modulation::MT Generate Filter Coefficients.gvi
  NI::Modulation::MT Generate ASK system parameters (M).gvi
  NI::Modulation::MT Demodulate ASK.gvi
diagram:
  call "niUSRP Open Rx Session.gvi"(device names=$"device names") -> (session handle out=w1, error out=w2)
  call "niUSRP Configure Signal.gvi"(active antenna=$"active antenna", session handle=w1, error in=w2, IQ rate=$"IQ rate", carrier frequency=$"carrier frequency", gain=$gain) -> (session handle out=w3, error out=w4, coerced IQ rate=w5, coerced carrier frequency=w6, coerced gain=w7)
  Divide(x=w5, y=$"symbol rate") -> w8
  Multiply($"message length", w8) -> w9
  call "niUSRP Initiate.gvi"(session handle=w3, error in=w4) -> (session handle out=w10, error out=w11)
  call "niUSRP Fetch Rx Data (CDB Cluster).gvi"(session handle=w10, error in=w11, number of samples=w9) -> (session handle out=w12, error out=w13, data=w14)
  call "niUSRP Abort.gvi"(session handle=w12, error in=w13) -> (session handle out=w15, error out=w16)
  call "niUSRP Close Session.gvi"(session handle=w15, error in=w16) -> (error out=w17)
  call "Simple Error Handler.gvi"(error in=w17) -> (error out=w18)
  $"error out" <- w18
  $"coerced IQ rate" <- w5
  # no. samples
  Property Node(instance in=w14) -> ("Y"=w19, instance out=w20)
  Complex To Real Imaginary(x + iy=w19) -> (x=w21)
  $Graph_2 <- w21
  $"coerced carrier frequency" <- w6
  $"coerced gain" <- w7
  call "MT Generate Filter Coefficients.gvi"(matched samples per symbol=w8, modulation type="ASK") -> (matched filter coefficients=w22)
  call "MT Generate ASK system parameters (M).gvi"(samples per symbol=w8) -> (ASK system parameters=w23)
  call "MT Demodulate ASK.gvi"(input complex waveform=w20, ASK system parameters=w23, matched filter coefficients=w22) -> (recovered complex waveform=w24, output bit stream=w25)
  $Graph <- w24
  $"output bit stream" <- w25
