vi "Transmiter_ASK,FSK,PSK.gvi"   [LabVIEW NXG 3.0.0]
panel controls:
  "message length": i32 = 128
  "device names": "USRP niUSRPClass"
  "IQ rate": f64 = 100000
  "carrier frequency": f64 = 100000
  "gain": f64
  "symbol rate": f64
  "Stop": bool
  "active antenna": string
panel indicators:
  "coerced IQ rate": f64
  "coerced carrier frequency": f64
  "coerced gain": f64
  "output bit stream": i8[]
  "error out": error
  "Baseband Power Spectrum": T1
  "Graph": f64[]
types:
  T1 = cluster{"f0": f64, "df": f64, "magnitude": f64[]}
uses:
  NI::USRP::niUSRP Open Tx Session.gvi
  NI::USRP::niUSRP Configure Signal.gvi
  NI::Modulation::MT Generate Bits (Fibonacci, PN Order).gvi
  NI::Modulation::MT Generate ASK system parameters (M).gvi
  NI::Modulation::MT Generate Filter Coefficients.gvi
  NI::Modulation::MT Modulate ASK.gvi
  NI::USRP::niUSRP Write Tx Data (CDB Cluster).gvi
  NI::USRP::niUSRP Close Session.gvi
  NI::G Core::Error::Legacy::Simple Error Handler.gvi
  NI::Analysis::Measurement::Power Spectrum for 1 Chan (CDB).gvi
diagram:
  call "niUSRP Open Tx Session.gvi"(device names=$"device names") -> (session handle out=w1, error out=w2)
  call "niUSRP Configure Signal.gvi"(active antenna=$"active antenna", session handle=w1, error in=w2, IQ rate=$"IQ rate", carrier frequency=$"carrier frequency", gain=$gain) -> (session handle out=w3, error out=w4, coerced IQ rate=w5, coerced carrier frequency=w6, coerced gain=w7)
  call "MT Generate Bits (Fibonacci, PN Order).gvi"(total bits=$"message length") -> (output bit stream=w8)
  Divide(x=w5, y=$"symbol rate") -> w9
  call "MT Generate ASK system parameters (M).gvi"(samples per symbol=w9) -> (ASK system parameters=w10)
  call "MT Generate Filter Coefficients.gvi"(pulse shaping samples per symbol=w9, modulation type="ASK") -> (pulse shaping filter coefficients=w11)
  call "MT Modulate ASK.gvi"(input bit stream=w8, ASK system parameters=w10, symbol rate=$"symbol rate", pulse shaping filter coefficients=w11) -> (output complex waveform=w12)
  while {
    call "niUSRP Write Tx Data (CDB Cluster).gvi"(session handle=w3, error in=w4, data=w12, end of data?=$Stop) -> (session handle out=w13, error out=w14)
    Logical Or(w14, $Stop) -> w15
    stop if w15
  }
  call "niUSRP Close Session.gvi"(session handle=w13, error in=w14) -> (error out=w16)
  call "Simple Error Handler.gvi"(error in=w16) -> (error out=w17)
  $"error out" <- w17
  $"coerced IQ rate" <- w5
  $"coerced carrier frequency" <- w6
  $"output bit stream" <- w8
  $"coerced gain" <- w7
  Property Node(instance in=w12) -> ("Y"=w18, "dt"=w19)
  Complex To Real Imaginary(x + iy=w18) -> (x=w20)
  $Graph <- w20
  Build Waveform Node(Y=w18, dt=w19) -> (output waveform=w21)
  call "Power Spectrum for 1 Chan (CDB).gvi"(signal=w21) -> (power spectrum=w22)
  $"Baseband Power Spectrum" <- w22
